# Dynamo graph hollow_pipe.dyn "Создание полнотелых труб" (Dynamo 2.16.1.2727)

categories = Categories("OST_PipeCurves")
all_elements_of_category = ElementsOfCategory(Category=categories)
getLocation = Element.GetLocation(element=all_elements_of_category)
startPoint = Curve.StartPoint(curve=getLocation)
endPoint = Curve.EndPoint(curve=getLocation)
list_create = List.Create(item0=startPoint, item1=endPoint)
transpose = List.Transpose(lists=list_create)
family_types = FamilyTypes("труба стальная:труба стальная")
byPoints = AdaptiveComponent.ByPoints(points=transpose, familyType=family_types)
all_elements_of_family_type = ElementsOfFamilyType(Family_Type=family_types)
code_block = CodeBlock { "Dн"; }
code_block_2 = CodeBlock { "Внешний диаметр"; }
getParameterValueByName = Element.GetParameterValueByName(element=all_elements_of_category, parameterName=code_block_2)
setParameterByName = Element.SetParameterByName(element=all_elements_of_family_type, parameterName=code_block, value=getParameterValueByName)
code_block_3 = CodeBlock { "Dв"; }
code_block_4 = CodeBlock { "Внутренний диаметр"; }
getParameterValueByName_2 = Element.GetParameterValueByName(element=all_elements_of_category, parameterName=code_block_4)
setParameterByName_2 = Element.SetParameterByName(element=all_elements_of_family_type, parameterName=code_block_3, value=getParameterValueByName_2)
